# Requirement set IndicatorBoard (R2023a)

## 1 [IB 1] The CAV Longitudinal Status light is ON when operator has turned the switch on and the CAV supervisory controller is enabled
IB 1: The CAV Longitudinal Control Status light shall be ON when longitudinal control features are allowed and the operator is able to initiate features using other buttons in the vehicle while the longitudinal control system is physically connected to and able to communicate with the CAV supervisory controller.